# Grasshopper definition AdSecGH_Example1_RectangularBeam.gh (Grasshopper 1.0.7)
# Copyright: Arup
# plug-ins: AdSec, UnitNumber

material = StandardMaterial(Material_Type="Rebar", Design_Code=["EN1992", "GB"], Edition="Edition_2014", Grade="S500B")

# ---- group: Main profile
xy = XYPlane(Origin=Point(0, 0, 0))
profile = CreateProfile(
    Depth_mm=Slider(600, range=0..1000),
    Width_mm=Slider(300, range=0..1000),
    LocalPlane=xy,
    catalogueIndex=-1,
    inclSS=False,
    lengthUnit="Millimeter",
    mode="Other",
    Profile_type="Rectangle",
    Measure="Millimeter",
    typeIndex=-1)

# ---- group: Top
rebar = CreateRebar(Material=material, Diameter_mm=Slider(16, range=0..100), Rebar_Type="Single", Measure="Millimeter")
spacing = CreateRebarSpacing(Rebar=rebar, Count=Slider(4, range=0..10), LengthUnit="Meter", Mode="Count", Spacing_method="Count")

# ---- group: Sides
rebar_2 = CreateRebar(Material=material, Diameter_mm=Slider(16, range=0..100), Rebar_Type="Single", Measure="Millimeter")
spacing_2 = CreateRebarSpacing(
    Rebar=rebar_2,
    Spacing_mm=Slider(200, range=0..1000),
    LengthUnit="Millimeter",
    Mode="Distance",
    Spacing_method="Distance",
    Measure="mm")

# ---- group: Bottom
rebar_3 = CreateRebar(Material=material, Diameter_mm=Slider(25, range=0..100), Rebar_Type="Single", Measure="Millimeter")
spacing_3 = CreateRebarSpacing(Rebar=rebar_3, Count=Slider(4, range=0..10), LengthUnit="Meter", Mode="Count", Spacing_method="Count")

# ----
material_2 = StandardMaterial(Material_Type="Concrete", Design_Code=["EN1992", "GB"], Edition="Edition_2014", Grade="C30_37")
number_slider = Slider(30, range=0..100)

# ---- group: Links
rebar_4 = CreateRebar(Material=material, Diameter_mm=Slider(10, range=0..100), Rebar_Type="Single", Measure="Millimeter")
reinforcement_group = CreateReinforcementGroup(Rebar=rebar_4, Cover=number_slider, LengthUnit="Millimeter", Mode="Link", Group_Type="Link", Measure="mm")

# ----
reinforcement_group_2 = CreateReinforcementGroup(
    TopRebars=spacing,
    LeftSideRebars=spacing_2,
    RightSideRebars=spacing_2,
    BottomRebars=spacing_3,
    Cover=number_slider,
    LengthUnit="Millimeter",
    Mode="Template",
    Group_Type="Template",
    Measure="mm")
rbg = RebarGroup(flatten([reinforcement_group, reinforcement_group_2]))

# ---- group: Create Section
section = Section(Profile=profile, Material=material_2, RebarGroup=rbg)

# ----
sec = Section(section)
section_2 = Section(Section=section)  # -> Section, Profile, Material, DesignCode, RebarGroup, SubComponent, SectionCurves

# ---- group: Analyse solution
analyse = AnalyseSection(Section=section)  # -> Results, FailureSurface

# ----
profileedit = EditProfile(Profile=section_2.Profile, Measure="Radian")
neg = Negative(Value=Slider(200, range=0..10000))

# ---- group: Bake these guys
crv = Curve(section_2.SectionCurves)

# ---- group: Top right corner point
vertex_point = CreateVertexPoint(Y_mm=Slider(150, range=0..1000), Z_mm=Slider(-300, range=-500..0), Measure="Millimeter")

# ----
load = CreateLoad(
    Myy_kN_m=Slider(64, range=0..100),
    Mzz_kN_m=Slider(10, range=0..100),
    Force_Unit="Kilonewton",
    Moment_Unit="KilonewtonMeter")
load_2 = CreateLoad(
    Fx_kN=neg,
    Myy_kN_m=Slider(55, range=0..100),
    Mzz_kN_m=Slider(11, range=0..100),
    Force_Unit="Kilonewton",
    Moment_Unit="KilonewtonMeter")
lng = ListLength(List=crv)

# ---- group: CadTest
int = Integer(lng)

# ----
uls = StrengthResult(Results=analyse.Results, Load=load_2)  # -> Load, LoadUtil, Deformation, DeformationUtil, MomentRanges, NeutralAxis, NeutralAxisOffset, NeutralAxisAngle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

# ---- group: Rebar stress for all bars
rss = RebarStressStrain(Results=analyse.Results, Load=load_2)  # -> Position_m, ULS_ε, ULS_MPa, SLS_ε, SLS_MPa

# ---- group: Concrete stress at YZ point
css = ConcreteStressStrain(Results=analyse.Results, Load=load_2, VertexPoint=vertex_point)  # -> ULSStrain_ε, ULSStress_MPa, SLSStrain_ε, SLSStress_MPa

# ----
sls = ServiceabilityResult(Results=analyse.Results, Load=load)  # -> Load, Cracks, MaximumCrack, CrackUtil, Deformation, SecantStiffness, UncrackedMomentRanges

# ---- group: Neutral Axis
data = Data(uls.NeutralAxis)

# ---- group: Failure Neutral Axis
data_2 = Data(uls.FailureNeutralAxis)

# ---- group: Neutral Failure Offset
num = Number(uls.FailureNeutralAxisOffset)

# ---- group: Neutral Offset
num_2 = Number(uls.NeutralAxisOffset)

# ----
panel = Panel(uls.LoadUtil)
panel_2 = Panel(rss.Position_m)
pt = ConstructPoint(XCoordinate="500", YCoordinate=0, ZCoordinate=0)
panel_3 = Panel(sls.Cracks)
panel_4 = Panel(sls.CrackUtil)

# ---- group: Neutral Angle
num_3 = Number(uls.NeutralAxisAngle)

# ---- group: Neutral Failure Angle
num_4 = Number(uls.FailureNeutralAxisAngle)

# ----
rad = Radians(Degrees=Slider(-170, range=-190..90))
rectangle = Rectangle(Plane=pt, XSize=Slider(500, range=0..1000), YSize=Slider(605, range=0..1000), Radius=0)  # -> Rectangle, Length

# ---- group: LoadUtilisationTest
num_5 = Number(uls.LoadUtil)

# ---- group: CrackUtilisationTest
num_6 = Number(sls.CrackUtil)

# ----
convertunit = ConvertUnitNumber(UnitNumber=css.SLSStrain_ε, Select_output_unit="‰")  # -> UnitNumber, Number
convertunit_2 = ConvertUnitNumber(UnitNumber=css.ULSStrain_ε, Select_output_unit="‰")  # -> UnitNumber, Number
n_m_diagram = NMDiagram(Results=analyse.Results, MomentAngle_rad=rad, Plot=rectangle.Rectangle, Interaction="N-M", Measure="Radian")
convertunit_3 = ConvertUnitNumber(UnitNumber=rss.ULS_ε, Select_output_unit="‰")  # -> UnitNumber, Number
convertunit_4 = ConvertUnitNumber(UnitNumber=rss.SLS_ε, Select_output_unit="‰")  # -> UnitNumber, Number
panel_5 = Panel([convertunit_2.UnitNumber, css.ULSStress_MPa, convertunit.UnitNumber, css.SLSStress_MPa])

# ---- group: RebarUlsStressTest
num_7 = Number(rss.ULS_MPa)

# ---- group: RebarSlsStressTest
num_8 = Number(rss.SLS_MPa)

# ----
crv_2 = Curve(n_m_diagram)

# ---- group: RebarUlsStrainTest
num_9 = Number(convertunit_3.UnitNumber)

# ---- group: RebarSlsStrainTest
num_10 = Number(convertunit_4.UnitNumber)

# ----
boundary = BoundarySurfaces(Edges=crv_2)
panel_6 = Panel(convertunit_3.UnitNumber)
area = Area(Geometry=boundary)  # -> Area, Centroid

# ---- group: ConcreteStressTest
num_11 = Number([convertunit_2.UnitNumber, css.ULSStress_MPa, convertunit.UnitNumber, css.SLSStress_MPa])

# ---- group: NmDiagramTest
num_12 = Number(area.Area)
