# Grasshopper definition AdSecGH_Example3_GsaGh_AdSecGh.gh (Grasshopper 1.0.7)
# Copyright: Arup
# plug-ins: GSA, AdSec

material = StandardMaterial(Material_Type="Rebar", Design_Code=["EN1992", "GB"], Edition="Edition_2014", Grade="S500B")
ln = Line(StartPoint=Point(0, 0, 0), EndPoint=Point(1, 0, 0))
mem1d = Create1DMember(
    Curve=ln,
    Preview3dSection=False,
    x1=False,
    x2=False,
    xx1=False,
    xx2=False,
    y1=False,
    y2=False,
    yy1=False,
    yy2=False,
    z1=False,
    z2=False,
    zz1=False,
    zz2=False)
model = CreateModel(GSAGeometryIn_m=mem1d, ReMesh=True, Tolerance=0.01, Unit="m")
rebar = CreateRebar(Material=material, Diameter_mm=Slider(16, range=0..100), Rebar_Type="Single", Measure="Millimeter")
spacing = CreateRebarSpacing(Rebar=rebar, Count=Slider(4, range=0..10), Spacing_method="Count")
