# Grasshopper definition AdSecGH_Example4_LoadWrite.gh (Grasshopper 1.0.7)
# Copyright: Arup
# plug-ins: AdSec

material = StandardMaterial(Material_Type="Rebar", Design_Code=["EN1992", "GB"], Edition="Edition_2014", Grade="S500B")

# ---- group: Main profile
xy = XYPlane(Origin=Point(0, 0, 0))
profile = CreateProfile(
    Diameter_mm=Slider(500, range=0..1000),
    LocalPlane=xy,
    catalogueIndex=-1,
    inclSS=False,
    lengthUnit="Millimeter",
    mode="Other",
    Profile_type="Circle",
    Measure="Millimeter",
    typeIndex=-1)

# ---- group: Longitudinal bars
rebar = CreateRebar(Material=material, Diameter_mm=Slider(20, range=0..100), Rebar_Type="Single", Measure="Millimeter")
spacing = CreateRebarSpacing(Rebar=rebar, Spacing_mm=Slider(150, range=0..1000), Spacing_method="Distance", Measure="Millimeter")

# ----
material_2 = StandardMaterial(Material_Type="Concrete", Design_Code=["EN1992", "GB"], Edition="Edition_2014", Grade="C40_50")

# ---- group: Sub component for composite section
xy_2 = XYPlane(Origin=Point(0, 0, 0))
profile_2 = CreateProfile(
    LocalPlane=xy_2,
    catalogueIndex=3,
    inclSS=False,
    lengthUnit="Meter",
    mode="Catalogue",
    Profile_type="Catalogue",
    Catalogue="Europrofile",
    Type="EP HE beams",
    Profile="HE HE140.M",
    typeIndex=27)
material_3 = StandardMaterial(Material_Type="Steel", Design_Code="EN1993", Grade="S355")
profileedit = EditProfile(Profile=profile_2, Measure="Degree")
section = CreateSection(Profile=profileedit, Material=material_3)

# ----
number_slider = Slider(35, range=0..100)

# ---- group: Links
rebar_2 = CreateRebar(Material=material, Diameter_mm=Slider(10, range=0..100), Rebar_Type="Single", Measure="Millimeter")
reinforcement_group = CreateReinforcementGroup(Rebar=rebar_2, Cover=number_slider, LengthUnit="Millimeter", Mode="Link", Group_Type="Link", Measure="Millimeter")

# ----
reinforcement_group_2 = CreateReinforcementGroup(
    SpacedRebars=spacing,
    Cover=number_slider,
    LengthUnit="Millimeter",
    Mode="Perimeter",
    Group_Type="Perimeter",
    Measure="Millimeter")
rbg = RebarGroup(flatten([reinforcement_group_2, reinforcement_group]))

# ---- group: Create Section
section_2 = Section(Profile=profile, Material=material_2, RebarGroup=rbg, SubComponent=section)

# ----
material_4 = StandardMaterial(Material_Type="Concrete", Design_Code=["EN1992", "GB"], Edition="Edition_2014", Grade="C30_37")
editsection = EditSection(Section=section_2, Material=material_4)  # -> Section, Profile, Material, DesignCode, RebarGroup, SubComponent, SectionCurves
c_script = CSharpScript()  # -> out, A
# ---------- c_script: C# usings ----------
using System.IO;
# ---------- c_script: C# ----------
    A = Path.Combine(Path.GetTempPath(), Path.GetTempFileName() + ".ads");
# ---------- end c_script ----------
save_adsec = SaveAdSec(
    Section=editsection.Section,
    Save=Toggle(True),
    FileAndPath=c_script.A,
    File="C:\Users\sandeep.kumar\AppData\Local\Temp\tmpBFFF.tmp.ads")
