# Grasshopper definition AdSecGH_Example5_CustomMaterial.gh (Grasshopper 1.0.7)
# Copyright: Arup
# plug-ins: AdSec

designcode = CreateDesignCode(Code_Group="EN1992", Part="Part1_1", National_Annex="DE", Edition="Edition_2013")
stressstrainpt = CreateStressStrainPt(Strain_=Slider(10, range=0..10), Stress_N_mm²=Slider(3, range=0..10), Strain_Unit="‰", Stress_Unit="N/mm²")
crackcalcparams = CreateCrackCalcParams(ElasticModulus_MPa="1", Compression_MPa="1", Tension_MPa="1", Elasticity_Unit="MPa", Strength_Unit="MPa")
stressstraincrv = CreateStressStrainCrv(FailurePoint=stressstrainpt, Curve_Type="Linear", Strain_Unit="‰")
custommaterial = CustomMaterial(
    DesignCode=designcode,
    ULSCompCrv=stressstraincrv,
    ULSTensCrv=stressstraincrv,
    SLSCompCrv=stressstraincrv,
    SLSTensCrv=stressstraincrv,
    YieldPointCrackCalcParams=crackcalcparams,
    isConcrete=True,
    Material_Type="Concrete")
profile = CreateProfile(
    Depth_cm="100",
    Width_cm="100",
    LocalPlane=PlaneYZ(0, 0, 0),
    catalogueIndex=-1,
    inclSS=False,
    lengthUnit="Centimeter",
    mode="Other",
    Profile_type="Rectangle",
    Measure="cm",
    typeIndex=-1)
materialedit = EditMaterial(Material=custommaterial)  # -> Material, DesignCode, ULSCompCrv, ULSTensCrv, SLSCompCrv, SLSTensCrv, CrackCalcParams
section = CreateSection(Profile=profile, Material=custommaterial)
number_slider = Slider(0.003, range=0..8)
panel = Panel(custommaterial)
analyse = AnalyseSection(Section=section)  # -> Results, FailureSurface
deformation = CreateDeformationLoad(Κyy_m_¹=number_slider, Κzz_m_¹=number_slider, Strain_Unit="‰", Curvature_Unit="m⁻¹")
uls = StrengthResult(Results=analyse.Results, Load=deformation)  # -> Load, LoadUtil, Deformation, DeformationUtil, MomentRanges, NeutralAxis, NeutralAxisOffset, NeutralAxisAngle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

# ---- group: LoadUtil
num = Number(uls.LoadUtil)

# ---- group: DeformUtil
num_2 = Number(uls.DeformationUtil)

# ---- group: FA Angle
num_3 = Number(uls.FailureNeutralAxisAngle)

# ---- group: NA Angle
num_4 = Number(uls.NeutralAxisAngle)

# ----
panel_2 = Panel([uls.NeutralAxisOffset, uls.NeutralAxisAngle, uls.FailureNeutralAxisOffset, uls.FailureNeutralAxisAngle])
panel_3 = Panel(uls.DeformationUtil)
