# Grasshopper definition AdSecGh_Compatability_With_GsaGh.gh (Grasshopper 1.0.7)
# Copyright: Arup
# plug-ins: AdSec, GSA

number_slider = Slider(10, range=0..10)
create_profile = CreateProfile(
    Depth_cm=number_slider,
    Width_cm=number_slider,
    catalogueIndex=-1,
    inclSS=False,
    lengthUnit="Centimeter",
    mode="Other",
    Profile_type="Rectangle",
    Measure="cm",
    typeIndex=-1)
standard_material = StandardMaterial(Material_Type="Concrete", Design_Code=["EN1992", "GB"], Edition="Edition_2014", Grade="C30_37")

# ---- group: Section
create_section = CreateSection(Profile=create_profile, Material=standard_material)

# ---- group: Section Description
panel = Panel(create_section)

# ----
analyse_section = AnalyseSection(Section=create_section)  # -> Results, FailureSurface
