# Grasshopper definition CreateProfile.gh (Grasshopper 1.0.7)
# Copyright: Arup
# plug-ins: AdSec

xy = XYPlane(Origin=Point(0, 0, 0))
xy_2 = XYPlane(Origin=Point(0, 0, 0))
xy_3 = XYPlane(Origin=Point(0, 0, 0))
xy_4 = XYPlane(Origin=Point(0, 0, 0))
xy_5 = XYPlane(Origin=Point(0, 0, 0))
xy_6 = XYPlane(Origin=Point(0, 0, 0))
xy_7 = XYPlane(Origin=Point(0, 0, 0))
xy_8 = XYPlane(Origin=Point(0, 0, 0))
xy_9 = XYPlane(Origin=Point(0, 0, 0))
xy_10 = XYPlane(Origin=Point(0, 0, 0))
xy_11 = XYPlane(Origin=Point(0, 0, 0))
xy_12 = XYPlane(Origin=Point(0, 0, 0))
xy_13 = XYPlane(Origin=Point(0, 0, 0))
xy_14 = XYPlane(Origin=Point(0, 0, 0))  # disabled
xy_15 = XYPlane(Origin=Point(0, 0, 0))
xy_16 = XYPlane(Origin=Point(0, 0, 0))
xy_17 = XYPlane(Origin=Point(0, 0, 0))  # disabled
xy_18 = XYPlane(Origin=Point(0, 0, 0))
xy_19 = XYPlane(Origin=Point(0, 0, 0))
xy_20 = XYPlane(Origin=Point(0, 0, 0))
xy_21 = XYPlane(Origin=Point(0, 0, 0))
xy_22 = XYPlane(Origin=Point(0, 0, 0))
panel = Panel("200")  # disabled
panel_2 = Panel("300")  # disabled
panel_3 = Panel("200")  # disabled
xy_23 = XYPlane(Origin=Point(0, 0, 0))
panel_4 = Panel("300")  # disabled
panel_5 = Panel("20")  # disabled
panel_6 = Panel("10")  # disabled
panel_7 = Panel("20")  # disabled
panel_8 = Panel("10")  # disabled
profile = CreateProfile(
    LocalPlane=xy_2,
    catalogueIndex=2,
    inclSS=False,
    lengthUnit="Millimeter",
    mode="Catalogue",
    Profile_type="Catalogue",
    Catalogue="British",
    Type="Parallel flange I sections(IPE) - EN10365:2017",
    Profile="BSI-IPE IPE100",
    typeIndex=248)
profile_2 = CreateProfile(
    Depth_mm="200",
    Width_mm="300",
    WebThk_mm="10",
    FlangeThk_mm="20",
    LocalPlane=xy,
    catalogueIndex=-1,
    inclSS=False,
    lengthUnit="Millimeter",
    mode="Other",
    Profile_type="Angle",
    Measure="mm",
    typeIndex=-1)
profile_3 = CreateProfile(
    Depth_mm="200",
    Width_mm="300",
    WebThk_mm="10",
    FlangeThk_mm="20",
    LocalPlane=xy_3,
    catalogueIndex=-1,
    inclSS=False,
    lengthUnit="Millimeter",
    mode="Other",
    Profile_type="Channel",
    Measure="mm",
    typeIndex=-1)
profile_4 = CreateProfile(
    Diameter_mm="200",
    Thickness_mm="10",
    LocalPlane=xy_4,
    catalogueIndex=-1,
    inclSS=False,
    lengthUnit="Millimeter",
    mode="Other",
    Profile_type="Circle Hollow",
    Measure="mm",
    typeIndex=-1)
profile_5 = CreateProfile(
    Depth_mm="200",
    TopFlangeWidth_mm="300",
    BottomFlangeWidth_mm="100",
    WebThickness_mm="20",
    TopFlangeThk_mm="15",
    BottomFlangeThk_mm="50",
    LocalPlane=xy_11,
    catalogueIndex=-1,
    inclSS=False,
    lengthUnit="Millimeter",
    mode="Other",
    Profile_type="I Beam Asymmetrical",
    Measure="mm",
    typeIndex=-1)
profile_6 = CreateProfile(
    Diameter_mm="300",
    LocalPlane=xy_5,
    catalogueIndex=-1,
    inclSS=False,
    lengthUnit="Millimeter",
    mode="Other",
    Profile_type="Circle",
    Measure="mm",
    typeIndex=-1)
profile_7 = CreateProfile(
    Depth_mm="200",
    Width_mm="300",
    Thickness_mm="10",
    LocalPlane=xy_6,
    catalogueIndex=-1,
    inclSS=False,
    lengthUnit="Millimeter",
    mode="Other",
    Profile_type="Ellipse Hollow",
    Measure="mm",
    typeIndex=-1)
profile_8 = CreateProfile(
    Depth_mm="200",
    Width_mm="300",
    LocalPlane=xy_7,
    catalogueIndex=-1,
    inclSS=False,
    lengthUnit="Millimeter",
    mode="Other",
    Profile_type="Ellipse",
    Measure="mm",
    typeIndex=-1)
profile_9 = CreateProfile(
    Depth_mm="200",
    Width_mm="300",
    WebThk_mm="10",
    FlangeThk_mm="20",
    LocalPlane=xy_8,
    catalogueIndex=-1,
    inclSS=False,
    lengthUnit="Millimeter",
    mode="Other",
    Profile_type="Cruciform Symmetrical",
    Measure="mm",
    typeIndex=-1)
profile_10 = CreateProfile(
    Boundary=panel,
    Plane=panel_2,
    LocalPlane=xy_14,
    catalogueIndex=-1,
    inclSS=False,
    lengthUnit="Millimeter",
    mode="Other",
    Profile_type="Perimeter",
    Measure="mm",
    typeIndex=-1)  # disabled
profile_11 = CreateProfile(
    Depth_mm="200",
    Width_mm="300",
    WebThk_mm="10",
    FlangeThk_mm="20",
    LocalPlane=xy_12,
    catalogueIndex=-1,
    inclSS=False,
    lengthUnit="Millimeter",
    mode="Other",
    Profile_type="I Beam Symmetrical",
    Measure="mm",
    typeIndex=-1)
profile_12 = CreateProfile(
    Depth_mm="200",
    TopWidth_mm="300",
    BottomWidth_mm="250",
    TopLip_mm="100",
    Lip_mm="50",
    Thickness_mm="20",
    LocalPlane=xy_10,
    catalogueIndex=-1,
    inclSS=False,
    lengthUnit="Millimeter",
    mode="Other",
    Profile_type="General Z",
    Measure="mm",
    typeIndex=-1)
profile_13 = CreateProfile(
    Depth_mm="200",
    Width_mm="300",
    Lip_mm="50",
    Thickness_mm="20",
    LocalPlane=xy_9,
    catalogueIndex=-1,
    inclSS=False,
    lengthUnit="Millimeter",
    mode="Other",
    Profile_type="General C",
    Measure="mm",
    typeIndex=-1)
profile_14 = CreateProfile(
    Depth_mm="200",
    Width_mm="300",
    WebThk_mm="10",
    FlangeThk_mm="20",
    WebOpening_mm="50",
    Pitch_mm="200",
    LocalPlane=xy_13,
    catalogueIndex=-1,
    inclSS=False,
    lengthUnit="Millimeter",
    mode="Other",
    Profile_type="I Beam Cellular",
    Measure="mm",
    typeIndex=-1)
profile_15 = CreateProfile(
    Depth_mm=panel_3,
    Width_mm=panel_4,
    WebThk_mm=panel_8,
    FlangeThk_mm=panel_7,
    LocalPlane=xy_17,
    catalogueIndex=-1,
    inclSS=False,
    lengthUnit="Millimeter",
    mode="Other",
    Profile_type="Rectangle Hollow",
    Measure="mm",
    typeIndex=-1)  # disabled
profile_16 = CreateProfile(
    Depth_mm="200",
    Width_mm="300",
    LocalPlane=xy_15,
    catalogueIndex=-1,
    inclSS=False,
    lengthUnit="Millimeter",
    mode="Other",
    Profile_type="Rectangle",
    Measure="mm",
    typeIndex=-1)
profile_17 = CreateProfile(
    Depth_mm="200",
    DepthFlat_mm="10",
    Width_mm="300",
    WidthFlat_mm="20",
    LocalPlane=xy_16,
    catalogueIndex=-1,
    inclSS=False,
    lengthUnit="Millimeter",
    mode="Other",
    Profile_type="Recto Ellipse",
    Measure="mm",
    typeIndex=-1)
profile_18 = CreateProfile(
    Diameter_mm="300",
    PileCentres_mm="200",
    PileCount="2",
    IsWall=Toggle(False),
    LocalPlane=xy_19,
    catalogueIndex=-1,
    inclSS=False,
    lengthUnit="Millimeter",
    mode="Other",
    Profile_type="Secant Pile",
    Measure="mm",
    typeIndex=-1)
profile_19 = CreateProfile(
    Depth_mm="300",
    Width_mm="500",
    TopFlangeWidth_mm="40",
    BottomFlangeWidth_mm="60",
    FlangeThickness_mm="30",
    WebThickness_mm="10",
    LocalPlane=xy_20,
    catalogueIndex=-1,
    inclSS=False,
    lengthUnit="Millimeter",
    mode="Other",
    Profile_type="Sheet Pile",
    Measure="mm",
    typeIndex=-1)
profile_20 = CreateProfile(
    Depth_mm="200",
    Width_mm="300",
    LocalPlane=xy_18,
    catalogueIndex=-1,
    inclSS=False,
    lengthUnit="Millimeter",
    mode="Other",
    Profile_type="Recto Circle",
    Measure="mm",
    typeIndex=-1)
profile_21 = CreateProfile(
    Diameter_mm="300",
    PileCentres_mm="200",
    PileCount="2",
    IsWall=Toggle(True),
    LocalPlane=xy_21,
    catalogueIndex=-1,
    inclSS=False,
    lengthUnit="Millimeter",
    mode="Other",
    Profile_type="Secant Pile",
    Measure="mm",
    typeIndex=-1)
profile_22 = CreateProfile(
    Depth_mm="300",
    TopWidth_mm="500",
    BottomWidth_mm="40",
    LocalPlane=xy_22,
    catalogueIndex=-1,
    inclSS=False,
    lengthUnit="Millimeter",
    mode="Other",
    Profile_type="Trapezoid",
    Measure="mm",
    typeIndex=-1)
profile_23 = CreateProfile(
    Depth_mm="300",
    Width_mm="500",
    WebThk_mm="40",
    FlangeThk_mm="30",
    LocalPlane=xy_23,
    catalogueIndex=-1,
    inclSS=False,
    lengthUnit="Millimeter",
    mode="Other",
    Profile_type="T Section",
    Measure="mm",
    typeIndex=-1)
panel_9 = Panel(profile_2)
panel_10 = Panel(profile_3)
panel_11 = Panel(profile_4)
panel_12 = Panel(profile)
panel_13 = Panel(profile_6)
panel_14 = Panel(profile_7)
panel_15 = Panel(profile_8)
panel_16 = Panel(profile_9)
panel_17 = Panel(profile_13)
panel_18 = Panel(profile_11)
panel_19 = Panel(profile_12)
panel_20 = Panel(profile_5)
panel_21 = Panel(profile_14)
panel_22 = Panel(profile_10)  # disabled
panel_23 = Panel(profile_15)  # disabled
panel_24 = Panel(profile_16)
panel_25 = Panel(profile_17)
panel_26 = Panel(profile_20)
panel_27 = Panel(profile_19)
panel_28 = Panel(profile_18)
panel_29 = Panel(profile_22)
panel_30 = Panel(profile_21)
panel_31 = Panel(profile_23)

# ---- group: IPE100
txt = Text(panel_12)

# ---- group: A
txt_2 = Text(panel_9)

# ---- group: CH
txt_3 = Text(panel_10)

# ---- group: CHS
txt_4 = Text(panel_11)

# ---- group: C
txt_5 = Text(panel_13)

# ---- group: OVAL
txt_6 = Text(panel_14)

# ---- group: E
txt_7 = Text(panel_15)

# ---- group: X
txt_8 = Text(panel_16)

# ---- group: GC
txt_9 = Text(panel_17)

# ---- group: I
txt_10 = Text(panel_18)

# ---- group: GZ
txt_11 = Text(panel_19)

# ---- group: GI
txt_12 = Text(panel_20)

# ---- group: CB
txt_13 = Text(panel_21)

# ---- group: R
txt_14 = Text(panel_24)

# ----
txt_15 = Text(panel_22)  # disabled

# ---- group: RE
txt_16 = Text(panel_25)

# ----
txt_17 = Text(panel_23)  # disabled

# ---- group: RC
txt_18 = Text(panel_26)

# ---- group: SP
txt_19 = Text(panel_28)

# ---- group: SHT
txt_20 = Text(panel_27)

# ---- group: TR
txt_21 = Text(panel_29)

# ---- group: SPW
txt_22 = Text(panel_30)

# ---- group: T
txt_23 = Text(panel_31)
